# Grasshopper definition Europa-refactored.gh (Grasshopper 1.0.7)

column_thickness_ft = Slider(0.5, range=0..1)
column_width_ft = Slider(4, range=0..6)
floorheight = Slider(9.5, range=7..13)
floorcount = Slider(3, range=1..4)
columncurves = ColumnCurves(colthickness=column_thickness_ft, collength=column_width_ft)  # -> lcurve_2, tcurve_2, thincolcurve_2
europagrid = EuropaGrid(size=Slider(33, range=25..45), gridcount="3")  # -> edgepoints_2, edgevertices_2, origin_2, floorrect_2, center_2, gridpoints_2
floorplates = FloorPlates(floorcount=floorcount, floorheight=floorheight, baserect=europagrid.floorrect_2)

panel = Panel("""0
1
2
3""")
multiplication = Multiplication(A=panel, B="0.5*pi")
rotate = Rotate(Geometry=columncurves.lcurve_2, Angle=multiplication, Plane=PlaneXY(0, 0, 0))  # -> Geometry, Transform
move = Move(Geometry=rotate.Geometry, Motion=europagrid.edgevertices_2)  # -> Geometry, Transform

exdiff = SetDifferenceS(SetA=europagrid.edgepoints_2, SetB=europagrid.edgevertices_2)  # -> simplify(ExDifference)
t_points = Point(exdiff)

panel_2 = Panel(t_points)
panel_3 = Panel("""0.5
0.5
1
1
-0.5
-0.5
0
0""")
pi = Pi(Factor=panel_3)
move_2 = Move(Geometry=columncurves.tcurve_2, Motion=t_points)  # -> Geometry, Transform
rotate_2 = Rotate(Geometry=move_2.Geometry, Angle=pi, Plane=t_points)  # -> Geometry, Transform

exdiff_2 = SetDifferenceS(SetA=flatten(europagrid.gridpoints_2), SetB=europagrid.edgepoints_2)
center4 = Point(exdiff_2)

multiplication_2 = Multiplication(A=floorheight, B=floorcount)

move_3 = Move(Geometry=columncurves.thincolcurve_2, Motion=center4)  # -> Geometry, Transform

floorplates_2 = Brep(floorplates)
move_4 = Move(Geometry=columncurves.thincolcurve_2, Motion=europagrid.center_2)  # -> Geometry, Transform
Z = UnitZ(Factor=multiplication_2)

extr = Extrude(Base=move.Geometry, Direction=Z)
capex = CapHolesEx(Brep=extr)  # -> Brep, Caps, Solid
brep = Brep([capex.Brep, floorplates_2])

extr_2 = Extrude(Base=[move.Geometry, rotate_2.Geometry, move_3.Geometry], Direction=Z)
capex_2 = CapHolesEx(Brep=extr_2)  # -> Brep, Caps, Solid
brep_2 = Brep([capex_2.Brep, floorplates_2])

extr_3 = Extrude(Base=[move.Geometry, move_4.Geometry], Direction=Z)
capex_3 = CapHolesEx(Brep=extr_3)  # -> Brep, Caps, Solid
brep_3 = Brep(simplify(capex_3.Brep))
brep_4 = Brep([brep_3, floorplates_2])

# ==== cluster EuropaGrid
size = ClusterInput()
gridcount = ClusterInput()
size_2 = Number(size)
gridcount_2 = Number(gridcount)
division = Division(A=size_2, B=gridcount_2)
origin = Point(Point(0, 0, 0))
rectangle = Rectangle(Plane=origin, XSize=size_2, YSize=size_2, Radius=0)  # -> Rectangle, Length
origin_2 = ClusterOutput(origin)
panel = Panel(division)
divlength = DivideLength(Curve=rectangle.Rectangle, Length=panel)  # -> Points, Tangents, Parameters
disc = Discontinuity(Curve=rectangle.Rectangle, Level=1)  # -> Points, Parameters
pcen = PolygonCenter(Polyline=rectangle.Rectangle)  # -> CenterV, CenterE, CenterA
xy = XYPlane(Origin=Point(0, 0, 0))
sqgrid = Square(Plane=xy, Size=division, ExtentX=gridcount_2, ExtentY=gridcount_2)  # -> simplify(Cells), simplify(Points)
edgevertices = Point(disc.Points)
floorrect = Rectangle(rectangle.Rectangle)
center = Point(pcen.CenterV)
edgepoints = Point(divlength.Points)
gridpoints = Point(sqgrid.Points)
center_2 = ClusterOutput(center)
floorrect_2 = ClusterOutput(floorrect)
edgepoints_2 = ClusterOutput(edgepoints)
edgevertices_2 = ClusterOutput(edgevertices)
gridpoints_2 = ClusterOutput(gridpoints)

# ==== cluster ColumnCurves
colthickness = ClusterInput()
collength = ClusterInput()
colthickness_2 = Number(colthickness)
collength_2 = Number(collength)
multiplication = Multiplication(A=collength_2, B="-1")
subtraction = Subtraction(A=multiplication, B="-0.2")
rectangle = Rectangle(Plane=PlaneXY(0, 0, 0), XSize=collength_2, YSize=colthickness_2, Radius=0)  # -> Rectangle, Length
rectangle_2 = Rectangle(Plane=PlaneXY(0, 0, 0), XSize=colthickness_2, YSize=collength_2, Radius=0)  # -> Rectangle, Length
Y = UnitY(Factor=subtraction)
cir = Circle(Plane=PlaneXY(0, 0, 0), Radius=colthickness_2)
move = Move(Geometry=rectangle_2.Rectangle, Motion=Y)  # -> Geometry, Transform
runion = RegionUnion(Curves=[rectangle.Rectangle, rectangle_2.Rectangle])
runion_2 = RegionUnion(Curves=[move.Geometry, rectangle_2.Rectangle, rectangle.Rectangle])
thincolcurve = Curve(cir)
lcurve = Curve(runion)
tcurve = Curve(runion_2)
lcurve_2 = ClusterOutput(lcurve)
thincolcurve_2 = ClusterOutput(thincolcurve)
tcurve_2 = ClusterOutput(tcurve)

# ==== cluster FloorPlates
floorcount = ClusterInput()
baserect = ClusterInput()
Z = UnitZ(Factor=1)
floorheight = ClusterInput()
_1tox = GhPythonScript(x=floorcount)  # -> a; inputs x: Int32
# ---------- _1tox: Python ----------
"""Provides a scripting component.
    Inputs:
        x: The x script variable
    Output:
        a: The a output variable"""

__author__ = "satyam"

import rhinoscriptsyntax as rs

a = range(1,x+1)
# ---------- end _1tox ----------
extr = Extrude(Base=baserect, Direction=Z)
capex = CapHolesEx(Brep=extr)  # -> Brep, Caps, Solid
multiplication = Multiplication(A=_1tox, B=floorheight)
multiplication_2 = Multiplication(A=_1tox, B="0.2")
addition = Addition(A=multiplication, B=multiplication_2)
Z_2 = UnitZ(Factor=multiplication)
move = Move(Geometry=capex.Brep, Motion=Z_2)  # -> Geometry, Transform
brep = Brep([capex.Brep, move.Geometry])
brep_2 = ClusterOutput(brep)
