# Grasshopper definition Europa.gh (Grasshopper 1.0.7)

division = Division(A="33", B="3")
origin = Point(Point(0, 0, 0))
rectangle = Rectangle(Plane=origin, XSize="33", YSize="33", Radius=0)  # -> Rectangle, Length
pcen = PolygonCenter(Polyline=rectangle.Rectangle)  # -> CenterV, CenterE, CenterA
disc = Discontinuity(Curve=rectangle.Rectangle, Level=1)  # -> Points, Parameters
panel = Panel(division)
divlength = DivideLength(Curve=rectangle.Rectangle, Length=panel)  # -> Points, Tangents, Parameters
edgepoints = Point(divlength.Points)
xy = XYPlane(Origin=Point(0, 0, 0))
edgevertices = Point(disc.Points)
center = Point(pcen.CenterV)
sqgrid = Square(Plane=xy, Size=division, ExtentX="3", ExtentY="3")  # -> simplify(Cells), simplify(Points)
exdiff = SetDifferenceS(SetA=edgepoints, SetB=edgevertices)  # -> simplify(ExDifference)
panel_2 = Panel(sqgrid.Points)
t_points = Point(exdiff)
panel_3 = Panel("""1
2""")
cir = Circle(Plane=center, Radius="0.5")
panel_4 = Panel("""0.5
0.5
1
1
-0.5
-0.5
0
0""")
multiplication = Multiplication(A=panel_3, B="9.5")
panel_5 = Panel(t_points)
multiplication_2 = Multiplication(A="4", B="-1")
Z = UnitZ(Factor="-0.2")
extr = Extrude(Base=rectangle.Rectangle, Direction=Z)
pi = Pi(Factor=panel_4)
exdiff_2 = SetDifferenceS(SetA=flatten(sqgrid.Points), SetB=edgepoints)
capex = CapHolesEx(Brep=extr)  # -> Brep, Caps, Solid
addition = Addition(A=multiplication, B="0.2")
rectangle_2 = Rectangle(Plane=origin, XSize="4", YSize="0.5", Radius=0)  # -> Rectangle, Length
rectangle_3 = Rectangle(Plane=PlaneXY(0, 0, 0), XSize="0.5", YSize="4", Radius=0)  # -> Rectangle, Length
subtraction = Subtraction(A=multiplication_2, B="-0.2")
multiplication_3 = Multiplication(A=disc.Parameters, B="0.5*pi")
pt = Point(exdiff_2)
Y = UnitY(Factor=subtraction)
Z_2 = UnitZ(Factor=addition)
runion = RegionUnion(Curves=[rectangle_2.Rectangle, rectangle_3.Rectangle])
cir_2 = Circle(Plane=pt, Radius="0.5")
move = Move(Geometry=rectangle_3.Rectangle, Motion=Y)  # -> Geometry, Transform
move_2 = Move(Geometry=capex.Brep, Motion=Z_2)  # -> Geometry, Transform
lcurve = Curve(runion)
rotate = Rotate(Geometry=lcurve, Angle=multiplication_3, Plane=PlaneXY(0, 0, 0))  # -> Geometry, Transform
runion_2 = RegionUnion(Curves=[move.Geometry, rectangle_3.Rectangle, rectangle_2.Rectangle])
brep = Brep([move_2.Geometry, capex.Brep])
tcurve = Curve(runion_2)
move_3 = Move(Geometry=tcurve, Motion=t_points)  # -> Geometry, Transform
rotate_2 = Rotate(Geometry=move_3.Geometry, Angle=pi, Plane=t_points)  # -> Geometry, Transform
move_4 = Move(Geometry=rotate.Geometry, Motion=edgevertices)  # -> Geometry, Transform
multiplication_4 = Multiplication(A="9.5", B="2")
Z_3 = UnitZ(Factor=multiplication_4)
extr_2 = Extrude(Base=[move_4.Geometry, cir_2], Direction=Z_3)
extr_3 = Extrude(Base=[move_4.Geometry, cir], Direction=Z_3)
extr_4 = Extrude(Base=[move_4.Geometry, cir_2, rotate_2.Geometry], Direction=Z_3)
capex_2 = CapHolesEx(Brep=extr_2)  # -> Brep, Caps, Solid
capex_3 = CapHolesEx(Brep=extr_3)  # -> Brep, Caps, Solid
capex_4 = CapHolesEx(Brep=extr_4)  # -> Brep, Caps, Solid
brep_2 = Brep(simplify(capex_3.Brep))
brep_3 = Brep([brep, capex_2.Brep])
brep_4 = Brep([brep, capex_4.Brep])
brep_5 = Brep([brep, brep_2])
